vi "Main.gviweb"   [LabVIEW NXG 2.0.0]
panel controls:
  "Input": string
panel indicators:
  "Output": string
diagram:
  w1 = ["It is certain", "It is decidedly so", "Without a doubt", "Yes definitely", "You may rely on it", "As I see it, yes", "Most likely", "Outlook good", "Yes", "Signs point to yes", "Reply hazy try again", "Ask again later", "Better not tell you now", "Cannot predict now", "Concentrate and ask again", "Don't count on it", "My reply is no", "My sources say no", "Outlook not so good", "Very doubtful"]
  Random Number() -> (number (0 to 1)=w2)
  Array Size(array=w1) -> (size(s)=w3)
  Decrement(x=w3) -> w4
  To Double Precision Float(number=w4) -> w5
  Multiply(w2, w5) -> w6
  To Long Integer(number=w6) -> w7
  Array Index(array=w1) -> (out0[w7]=w8)
  $Output <- w8
